# Grasshopper definition ParticleTest.gh (Grasshopper 1.0.7)
# plug-ins: TwinLand, Heteroptera, Weaverbird, Pufferfish

number_slider = Slider(60, range=10..200)
number_slider_2 = Slider(50, range=10..200)

dom = ConstructDomain(DomainStart=expr("x*-1", number_slider), DomainEnd=number_slider)
dom_2 = ConstructDomain(DomainStart=expr("x*-1", number_slider_2), DomainEnd=number_slider_2)
range = Range(Domain=dom_2, Steps=Slider(50, range=5..200))
item = ListItem(List=range, Index=0, Wrap=True)  # -> Item, Item1
subtraction = Subtraction(A=item.Item1, B=item.Item)
abs = Absolute(Value=subtraction)
particle_distance = Number(abs)

number_slider_3 = Slider(100, range=0..1000)
construct_domain = ConstructDomain(DomainStart=expr("-x", number_slider_3), DomainEnd=number_slider_3)
construct_domain_2 = ConstructDomain(DomainStart=expr("-x", number_slider_3), DomainEnd=number_slider_3)
construct_domain_3 = ConstructDomain(DomainStart=0, DomainEnd=number_slider_3)
number_slider_4 = Slider(10, range=0..100)
domain_box = DomainBox(Base=PlaneXY(0, 0, 0), X=construct_domain, Y=construct_domain_2, Z=construct_domain_3)
populate_3d = Populate3D(Region=domain_box, Count=20, Seed=1)
random_plane = RandomPlane(Origin=populate_3d)
center_box = CenterBox(Base=random_plane, X=number_slider_4, Y=number_slider_4, Z=number_slider_4)

division = Division(A=number_slider, B=particle_distance)
range_2 = Range(Domain=dom, Steps=expr("x*2", division))
series = Series(Start=particle_distance, Step=particle_distance, Count=Slider(3, range=1..20))
pt = ConstructPoint(XCoordinate=graft(range), YCoordinate=range_2, ZCoordinate=Slider(100, range=0..100))  # -> flatten(Point)
Z = UnitZ(Factor=series)
move = Move(Geometry=pt, Motion=graft(Z))  # -> flatten(Geometry), Transform
lng = ListLength(List=move.Geometry)
panel = Panel(lng)

panel_2 = Panel("""-1
0
1
0""")
panel_3 = Panel("""0
-1
0
1""")
multiplication = Multiplication(A=Slider(148.76, range=10..200), B=panel_2)
multiplication_2 = Multiplication(A=Slider(160.84, range=10..200), B=panel_3)
Y = UnitY(Factor=1)
X = UnitX(Factor=1)
Y_2 = UnitY(Factor=1)  # -> expr("x*-1", UnitVector)
X_2 = UnitX(Factor=1)  # -> expr("x*-1", UnitVector)
pt_2 = ConstructPoint(XCoordinate=multiplication, YCoordinate=multiplication_2, ZCoordinate=0)
merge = Merge(Data1=X, Data2=Y, Data3=X_2, Data4=Y_2)
pt_3 = Point(pt_2)
pl = PlaneNormal(Origin=pt_3, ZAxis=merge)
xy = XYPlane(Origin=Point(0, 0, 0))

mesh = Mesh(<mesh referenced from the Rhino model>)
weaverbird_s_split_triangles_subdivision = WeaverbirdsSplitTrianglesSubdivision(MeshCurves=mesh, Level=3)
toggle = BooleanToggle(True)
close_mesh = CloseMesh(Mesh=weaverbird_s_split_triangles_subdivision, Quadrangulate=True)  # -> Closed, Amount, Openings, ResultBoolean
flex_colliders = FleX_Colliders(Planes=flatten([xy, pl]), Boxes=flatten(center_box), Meshes=flatten(close_mesh.Closed))
panel_4 = Panel(close_mesh.Closed)
particlesfrompoints = ParticlesFromPoints(Points=move.Geometry, Mass=Slider(1, range=0..1), SelfCollision=toggle, IsFluid=toggle)
flex_parameters = FleX_Parameters(
    GravityAcceleration=Vector(0, 0, -9.807),
    MaximumRadius=expr("x*1.33333*2", particle_distance),
    SolidRestDistance=0.15,
    FluidRestDistance=expr("2*x", particle_distance),
    CollisionDistance=0.875,
    ParticleCollisionMargin=0.5,
    ShapeCollisionMargin=0.5,
    MaximumSpeed=3.402823466e+38,
    MaximumAcceleration=100,
    CoefficientOfDynamicFriction=0,
    CoefficientOfStaticFriction=0,
    CoefficientOfParticleFriction=0,
    Restitution=0,
    Adhesion=0,
    ParticleStopThreshold=0,
    ShockPropagation=0,
    Dissipation=0,
    Damping=0,
    IsFluid=True,
    Viscosity=Slider(0, range=0..10),
    Cohesion=Slider(0.025, range=0..10),
    SurfaceTension=Slider(0, range=0..10),
    SolidPressure=1,
    FreeSurfaceDrag=0,
    Buoyancy=1,
    SolidStopThreshold=0,
    SolidCreep=0,
    Drag=0,
    Lift=0,
    RelaxationMode=True,
    RelaxationFactor=1)
flex_options = FleX_Options(
    RefreshRate=Slider(6, range=0..100),
    SubSteps=3,
    Numiterations=3,
    SceneMode=0,
    FixNumberToTotalIteration=-1,
    MemoryRequirements=[131072, 96, 65536, 65536, 65536, 65536, 65536, 196608, 131972],
    StabilityScalingFactor=1)
flex_scene = FleX_Scene(Particles=flatten(particlesfrompoints))
flex_engine = FleX_Engine(
    FleX_Parameters=flex_parameters,
    FleX_Colliders=flex_colliders,
    FleX_Scene=flatten(flex_scene),
    FleX_Options=flex_options,
    Reset=Button(),
    Run=Toggle(False))  # -> FleX_Object, FleX_Log
panel_5 = Panel(flex_engine.FleX_Log)
getallparticles = GetAllParticles(FleXObject=flex_engine.FleX_Object, Interval=Slider(1, range=1..20))  # -> Point, Vector
cloud = CloudDisplay(
    Points=getallparticles.Point,
    Colours=graft(ColourSwatch(SwatchColor=RGB(255, 255, 255))),
    Size=particle_distance,
    SpriteType=0)
