# Grasshopper definition Fence.gh (Grasshopper 1.0.7)
# plug-ins: TwinLand

number_slider = Slider(10, range=0..10000)
number_slider_2 = Slider(60, range=0..10000)
number_slider_3 = Slider(1200, range=0..10000)
length = Slider(200, range=0..1000)
width = Slider(200, range=0..1000)
height = Slider(200, range=0..1000)
percentage = Slider(1, range=0..1)
multiplication = Multiplication(A=number_slider_2, B=Slider(4, range=0..10))
curve = Curve(<curve referenced from the Rhino model>)
divide_distance = DivideDistance(Curve=curve, Distance=multiplication)  # -> Points, Tangents, Parameters
construct_domain = ConstructDomain(DomainStart=expr("-x", number_slider_2), DomainEnd=number_slider_2)
construct_domain_2 = ConstructDomain(DomainStart=expr("-x", number_slider), DomainEnd=number_slider)
construct_domain_3 = ConstructDomain(DomainStart=expr("-x", number_slider_3), DomainEnd=expr("x/3", number_slider_3))
construct_plane = ConstructPlane(Origin=divide_distance.Points, XAxis=divide_distance.Tangents, YAxis=Vector(0, 1, 0))
domain_box = DomainBox(Base=construct_plane, X=construct_domain, Y=construct_domain_2, Z=construct_domain_3)
twinland_preview = TwinLandPreview(Geometry=domain_box, Thickness=1, Material=ColourSwatch(SwatchColor=RGB(255, 255, 255)))
