# Grasshopper definition SolidToPointCloud.gh (Grasshopper 1.0.7)
# plug-ins: TwinLand

brep = Brep(<brep referenced from the Rhino model>)
solidtopointcloud = SolidToPointCloud(Brep=brep, Spacing=Slider(10, range=0..10), Strict=invert(False))

bounding_box = BoundingBox(Content=brep, Plane=PlaneXY(0, 0, 0))  # -> Box, Box_2; disabled
number_slider = Slider(20, range=0..100)  # disabled
deconstruct_box = DeconstructBox(Box=bounding_box.Box)  # -> Plane, X, Y, Z; disabled
divide_domain = DivideDomain(Domain=deconstruct_box.X, Count=number_slider)  # disabled
divide_domain_2 = DivideDomain(Domain=deconstruct_box.Y, Count=number_slider)  # disabled
divide_domain_3 = DivideDomain(Domain=deconstruct_box.Z, Count=number_slider)  # disabled
deconstruct_domain = DeconstructDomain(Domain=divide_domain)  # -> Start, End; disabled
deconstruct_domain_2 = DeconstructDomain(Domain=divide_domain_2)  # -> Start, End; disabled
deconstruct_domain_3 = DeconstructDomain(Domain=divide_domain_3)  # -> Start, End; disabled
cross_reference = CrossReference(ListListA=deconstruct_domain.Start, ListListB=deconstruct_domain_2.Start, ListA=deconstruct_domain_3.Start, CrossMode=1)  # -> ListListA, ListListB, ListA; disabled
construct_point = ConstructPoint(XCoordinate=cross_reference.ListListA, YCoordinate=cross_reference.ListListB, ZCoordinate=cross_reference.ListA)  # -> flatten(Point); disabled
point_in_brep = PointInBrep(Brep=brep, Point=construct_point, Strict=False)  # disabled
cull_pattern = CullPattern(List=construct_point, CullPattern=point_in_brep)  # -> flatten(List); disabled
