# Grasshopper definition 230425_ConvexHull3D_MIConvexHull_GHPython_00.gh (Grasshopper 1.0.7)
# Copyright: Liljewall Arkitekter

# ---- group: Make Random Points
pop3d = Populate3D(
    Region={Plane=PlaneXY(0, 0, 0), X=Domain(0, 10), Y=Domain(0, 10), Z=Domain(0, 10)},
    Count=Slider(60, range=0..100),
    Seed=Slider(79, range=0..100))
pt = Point(pop3d)

# ---- group: Compute 3D Convex Hull Using MIConvexHull
python = GhPythonScript(Points=pt)  # -> ConvexHull; inputs Points: list
# ---------- python: Python ----------
import System
import Rhino as rc
import Grasshopper as gh
import clr
clr.AddReferenceToFileAndPath(gh.Folders.DefaultAssemblyFolder+"MIConvexHull.dll")
import MIConvexHull

def makeConvexHullMesh(points):
    
    """ Compute 3D convex hull as mesh from points using MIConvexHull """
    
    # Cast Rhino points to coordinate arrays
    pointsCoordinates = []
    for pt in points:
        xyz = System.Array[float]((pt.X,pt.Y,pt.Z))
        pointsCoordinates.append(xyz)
        
    # Compute convex hull
    hull = MIConvexHull.ConvexHull.Create(pointsCoordinates)
    
    # Convert hull to Rhino mesh
    hullMesh = rc.Geometry.Mesh()
    vertexCount = 0
    for hf in hull.Faces:
        for i in range(3):
            xyz = hf.Vertices[i].Position
            pt = rc.Geometry.Point3d(xyz[0],xyz[1],xyz[2])
            hullMesh.Vertices.Add(pt)
        hullMesh.Faces.AddFace(vertexCount,vertexCount+1,vertexCount+2)
        vertexCount += 3
        
    # Weld hull mesh and compute normals
    hullMesh.Weld(rc.RhinoMath.ToRadians(180))
    hullMesh.Normals.ComputeNormals()
    
    return hullMesh

ConvexHull = []
if Points:
    ConvexHull = makeConvexHullMesh(Points)
# ---------- end python ----------
