# Grasshopper definition ControlByKeyboard.gh (Grasshopper 1.0.7)
# plug-ins: TwinLand

control_boolean_toggle_by_keyboard = ControlBooleanToggleByKeyboard(BooleanToggle=Toggle(False), Active=True, HotKey="F4")
control_button_by_keyboard = ControlButtonByKeyboard(ButtonComponent=Button(), Active=True, HotKey="F3")
