# Grasshopper definition CustomConstraint.gh (Grasshopper 1.0.7)
# plug-ins: Heteroptera, TwinLand

number_slider = Slider(10, range=0..100)
number_slider_2 = Slider(10, range=0..100)
series = Series(Start=0, Step=number_slider_2, Count=number_slider)
series_2 = Series(Start=0, Step=number_slider_2, Count=number_slider)
series_3 = Series(Start=0, Step=number_slider_2, Count=number_slider)
cross_reference = CrossReference(ListListA=series, ListListB=series_2, ListA=series_3, CrossMode=1)  # -> ListListA, ListListB, ListA
number_slider_3 = Slider(0.5, range=0..100)
construct_point = ConstructPoint(XCoordinate=cross_reference.ListListA, YCoordinate=cross_reference.ListListB, ZCoordinate=cross_reference.ListA)
number_slider_4 = Slider(5, range=0..10)
center_box = CenterBox(Base=PlaneXY(0, 0, 0), X=number_slider_3, Y=number_slider_3, Z=number_slider_3)
random_plane = RandomPlane(Origin=construct_point)
param_viewer = ParamViewer(center_box)

brep_wireframe = BrepWireframe(Brep=center_box, Density=number_slider_4)
explode = Explode(Curve=brep_wireframe, Recursive=True)  # -> Segments, Vertices
shift_paths = ShiftPaths(Data=explode.Vertices, Offset=-1)
cull_duplicates = CullDuplicates(Points=shift_paths, Tolerance=0.1, CullMode=3)  # -> Points, Indices, Valence

orient = Orient(Geometry=center_box, Source=PlaneXY(0, 0, 0), Target=random_plane)  # -> Geometry, Transform

brep_wireframe_2 = BrepWireframe(Brep=orient.Geometry, Density=number_slider_4)
explode_2 = Explode(Curve=brep_wireframe_2, Recursive=True)  # -> Segments, Vertices
shift_paths_2 = ShiftPaths(Data=explode_2.Vertices, Offset=-1)
cull_duplicates_2 = CullDuplicates(Points=shift_paths_2, Tolerance=0.1, CullMode=3)  # -> Points, Indices, Valence

list_length = ListLength(List=flatten(cull_duplicates_2.Points))
list_length_2 = ListLength(List=flatten(cull_duplicates.Points))
series_4 = Series(Start=0, Step=1, Count=list_length)
partition_list = PartitionList(List=series_4, Size=list_length_2)
rigid_from_shape_matching = RigidFromShapeMatching(ConstraintPointIndices=partition_list, Stiffness=Slider(1, range=0..1))
particles_from_points = ParticlesFromPoints(Points=cull_duplicates_2.Points, Mass=Slider(1, range=0..10), SelfCollision=Toggle(True))
number_slider_5 = Slider(25, range=0..100)
expression = Expression(x=number_slider_3, Expression="x*1.2")
scene = Scene(Particles=flatten(particles_from_points), CustomConstraints=flatten(rigid_from_shape_matching))
xy_plane = XYPlane(Origin=Point(0, 0, 0))
options = Options(
    DurationTime=Slider(0.2, range=0..1),
    SubSteps=number_slider_5,
    Iteration=number_slider_5,
    SceneMode=0,
    FixedNumTotalIterations=-1,
    MemoryRequirements=[131072, 96, 65536, 65536, 65536, 65536, 65536, 196608, 131972],
    StabilityScalingFactor=1)
parameters = Parameters(
    GravityAcceleration=Vector(0, 0, -9.807),
    InteractionRadius=expression,
    SolidRestDistance=expression,
    FluidRestDistance=0.1,
    CollisionDistance=0.875,
    ParticleCollisionMargin=0.5,
    ShapeCollisionMargin=0.5,
    MaximumSpeed=3.402823466e+38,
    MaximumAcceleration=100,
    CoefficientOfDynamicFriction=Slider(0.3, range=0..10),
    CoefficientOfStaticFriction=0,
    CoefficientOfParticleFriction=0,
    Restitution=0,
    Adhesion=0,
    ParticleStopThreshold=0,
    ShockPropagation=0,
    Dissipation=0,
    Damping=0,
    IsFluid=True,
    Viscosity=0,
    Cohesion=0.025,
    SurfaceTension=0,
    SolidPressure=1,
    FreeSurfaceDrag=0,
    Buoyancy=1,
    PlasticStopThreshold=0,
    PlasticCreep=0,
    Wind=Vector(0, 0, 0),
    Drag=0,
    Lift=0,
    RelaxationMode=True,
    RelaxationFactor=1)
colliders = Colliders(Planes=flatten(xy_plane))
engine = Engine(
    Parameters=parameters,
    Colliders=colliders,
    Scenes=flatten(scene),
    SolverOptions=options,
    Reset=Button(),
    Run=Toggle(False))  # -> FleX, Log
get_rigid_transformations = GetRigidTransformations(FleX=engine.FleX)  # -> Translations, RotationAxis, RotationAngles, Transformations
transform = Transform(Geometry=orient.Geometry, Transform=get_rigid_transformations.Transformations)
