# Grasshopper definition MeshCarving.gh (Grasshopper 1.0.7)
# plug-ins: TwinLand

data = Data(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)
deconstruct_mesh = DeconstructMesh(Mesh=data)  # -> Vertices, Faces, Colours, Normals
data_2 = Data(flatten(Tree({1;3;0;0}: [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], {1;11;0;0}: [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], {1;13;0;0}: [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], {1;17;0;0}: [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], {1;19;0;0}: [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], {1;20;0;0}: [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]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)))
split_list = SplitList(List=data_2, Index=Slider(2, range=0..10))  # -> ListA, ListB
split_list_2 = SplitList(List=data_2, Index=Slider(10, range=0..10))  # -> ListA, ListB
data_3 = Data(split_list.ListA)
mesh_carving = MeshCarving(Boundary=split_list_2.ListA, Mesh=data, Sinking=Slider(10, range=0..10))
point_in_curves = PointInCurves(Point=deconstruct_mesh.Vertices, Curves=data_3)  # -> Relationship, Index, Point
equality = Equality(FirstNumber=point_in_curves.Relationship, SecondNumber=2)  # -> Equality, Inequality
unit_z = UnitZ(Factor=Slider(20, range=0..100))
sift_pattern = SiftPattern(List=deconstruct_mesh.Vertices, SiftPattern=equality.Equality)  # -> Output0, Output1
move = Move(Geometry=sift_pattern.Output1, Motion=expr("-x", unit_z))  # -> Geometry, Transform
addition = Addition(A=sift_pattern.Output0, B=move.Geometry)
construct_mesh = ConstructMesh(Vertices=addition, Faces=deconstruct_mesh.Faces)
