# Grasshopper definition MeshReduce.gh (Grasshopper 1.0.7)
# plug-ins: TwinLand

mesh = Mesh(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)

unit_z = UnitZ(Factor=6000)
move = Move(Geometry=mesh, Motion=unit_z)  # -> Geometry, Transform
mesh_convex_hull = MeshConvexHull(Mesh=move.Geometry, MinimumDistance=Slider(0, range=0..2000), Weld=Toggle(True), WeldAngle=Slider(0, range=0..1000))

unit_z_2 = UnitZ(Factor=3000)
move_2 = Move(Geometry=mesh, Motion=unit_z_2)  # -> Geometry, Transform
mesh_reduce = MeshReduce(
    Mesh=move_2.Geometry,
    DesireFaceCount=Slider(100, range=0..10000),
    Accuracy=Slider(10, range=0..10),
    NormalizeSize=True,
    AllowDistortion=True,
    Weld=Toggle(False),
    WeldAngle=Slider(200, range=0..1000))  # -> Mesh, ReducePercentage

colour_swatch = ColourSwatch(SwatchColor=RGB(255, 255, 255))

custom_preview = CustomPreview(Geometry=mesh_convex_hull, Material=colour_swatch)
deconstruct_mesh = DeconstructMesh(Mesh=mesh_convex_hull)  # -> Vertices, Faces, Colours, Normals
mesh_edges = MeshEdges(Mesh=mesh_convex_hull)  # -> NakedEdges, InteriorEdges, NonManifoldEdges

custom_preview_2 = CustomPreview(Geometry=mesh_reduce.Mesh, Material=colour_swatch)
deconstruct_mesh_2 = DeconstructMesh(Mesh=mesh_reduce.Mesh)  # -> Vertices, Faces, Colours, Normals
mesh_edges_2 = MeshEdges(Mesh=mesh_reduce.Mesh)  # -> NakedEdges, InteriorEdges, NonManifoldEdges

custom_preview_3 = CustomPreview(Geometry=mesh, Material=colour_swatch)
deconstruct_mesh_3 = DeconstructMesh(Mesh=mesh)  # -> Vertices, Faces, Colours, Normals
mesh_edges_3 = MeshEdges(Mesh=mesh)  # -> NakedEdges, InteriorEdges, NonManifoldEdges
