# Grasshopper definition ProjectAsPolygon.gh (Grasshopper 1.0.7)
# plug-ins: TwinLand

file_path = FilePath("C:\Users\carle\Desktop\temp\osmFile.osm")
importopenstreetmap = ImportOpenStreetMap(FilePath=file_path, OSMTag_KeyValue="natural=water", Clipped=False)  # -> Extends, Fields, Values, FeatureGeometry
unit_z = UnitZ(Factor=Slider(-2056, range=-20000..40000))
brep = Brep(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)
mesh = Mesh(brep)
move = Move(Geometry=mesh, Motion=unit_z)  # -> Geometry, Transform
data = Data(Tree({1;17}: [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], {1;34}: [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], {1;177}: [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], {1;178}: [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], {1;179}: [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], {1;186}: [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], {1;189}: [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], {1;190}: [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], {1;191}: [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], {1;192}: [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], {2;1}: [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]))
dem_mesh = Mesh(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)
project_as_polygon = ProjectAsPolygon(OSMFeatures=importopenstreetmap.FeatureGeometry, Geometry=move.Geometry)
