# Grasshopper definition TwinLandCounter.gh (Grasshopper 1.0.7)
# plug-ins: TwinLand

twinland_counter = TwinLandCounter(
    Interval=Slider(2000, range=0..10000),
    Start=0,
    End=Slider(58.8, range=0..100),
    Step=0.1,
    Active=Toggle(True),
    Reset=Button())
panel = Panel(twinland_counter)
