# Grasshopper definition customize canvas.gh (Grasshopper 1.0.7)
# plug-ins: TwinLand

# ----
# Doubleclick Me!
boolean_toggle = BooleanToggle(True)
colour_swatch = ColourSwatch(SwatchColor=RGB(255, 255, 255))
colour_swatch_2 = ColourSwatch(SwatchColor=RGB(0, 0, 0))
colour_swatch_3 = ColourSwatch(SwatchColor=RGB(204, 204, 204))

panel = Panel("""What

sdsdsd""")
customize_canvas = CustomizeCanvas(
    Canvas_grid=colour_swatch,
    Canvas_back=colour_swatch,
    Canvas_edge=colour_swatch,
    Canvas_shade=colour_swatch,
    Panel_back=colour_swatch_2,
    Wire_default=colour_swatch_2,
    Wire_empty=colour_swatch_2,
    Apply=boolean_toggle)
