# Grasshopper definition meshDeform.gh (Grasshopper 1.0.7)
# plug-ins: MeshEdit Components, Pufferfish

number_slider = Slider(50, range=0..1000)
number_slider_2 = Slider(61.1, range=0..100)
range = Range(Domain=Domain(0, 1), Steps=number_slider)
curve = Curve(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)
curve_2 = Curve(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)
parameter_rectangle_grid = ParameterRectangleGrid(Rectangle=curve_2, ParametersX=range, ParametersY=range)  # -> Cells, flatten(Points)
list_length = ListLength(List=parameter_rectangle_grid.Points)
random = Random(Range=Slider(10, range=0..100), Number=list_length, Seed=2)
unit_z = UnitZ(Factor=random)
move = Move(Geometry=parameter_rectangle_grid.Points, Motion=unit_z)  # -> Geometry, Transform
point_in_curve = PointInCurve(Point=move.Geometry, Curve=curve)  # -> Relationship, Point
equality = Equality(FirstNumber=point_in_curve.Relationship, SecondNumber=2)  # -> Equality, Inequality
sift_pattern = SiftPattern(List=move.Geometry, SiftPattern=equality.Equality)  # -> Output0, Output1
list_length_2 = ListLength(List=sift_pattern.Output1)
random_2 = Random(Range=Slider(26, range=0..2000), Number=list_length_2, Seed=2)
unit_z_2 = UnitZ(Factor=random_2)
move_2 = Move(Geometry=sift_pattern.Output1, Motion=unit_z_2)  # -> Geometry, Transform
addition = Addition(A=sift_pattern.Output0, B=move_2.Geometry)  # -> flatten(Result)
mesh_frompoints = MeshFromPoints(Points=addition, UDirection=expr("x+1", number_slider), VDirection=expr("x+1", number_slider))
