# Grasshopper definition particle pileup.gh (Grasshopper 1.0.7)
# plug-ins: TwinLand

number_slider = Slider(3, range=0..100)
brep_lattice = BrepLattice(Brep=<brep referenced from the Rhino model>, Spacing=Slider(2, range=0..100), Strict=True)
sand_generator = SandGenerator(
    Plane=brep_lattice,
    MaximumWidth=number_slider,
    MaximumLength=number_slider,
    MaximumHeight=number_slider,
    VertexCount=Slider(12, range=0..100),
    SizeEvenFactor=1)  # -> Mesh, Vertices, ConstraintPointIndices
data = Data(sand_generator.Mesh)
