# Grasshopper definition sand generator.gh (Grasshopper 1.0.7)
# plug-ins: Heteroptera, TwinLand

number_slider = Slider(100, range=0..100)
center_box = CenterBox(Base=PlaneXY(0, 0, 0), X=number_slider, Y=number_slider, Z=number_slider)
populate_3d = Populate3D(Region=center_box, Count=100, Seed=1)
number_slider_2 = Slider(25.5, range=0..100)
random_plane = RandomPlane(Origin=populate_3d)
sand_generator = SandGenerator(
    Plane=random_plane,
    MaximumWidth=number_slider_2,
    MaximumLength=number_slider_2,
    MaximumHeight=Slider(10, range=0..20000),
    VertexCount=Slider(31, range=0..100),
    SizeEvenFactor=Slider(1, range=0..1))  # -> Mesh, Vertices
data = Data(sand_generator.Mesh)
